# Grasshopper definition example_AIGGC.gh (Grasshopper 1.0.8)
# plug-ins: AIGGC_agent

# ----
# Step 1:
# Setup virtual environment and dependencies
boolean_toggle = BooleanToggle(True)
_1_envsetup = _1_EnvSetup(Setup=boolean_toggle)
panel = Panel(_1_envsetup)

# ----
# Step 2:
# Launch LLM server
boolean_toggle_2 = BooleanToggle(True)
_2_llmlauncher = _2_LLMLauncher(Launch=boolean_toggle_2)
panel_2 = Panel(_2_llmlauncher)

initial_interval_range_for_each_design_p = Panel("""(3.8273,6.3273,1.25)
(3.8273,6.3273,1.25)
(3.8273,6.3273,1.25)
(3.8273,6.3273,1.25)
(3.8273,6.3273,1.25)
(3.8273,6.3273,1.25)
(3.8273,6.3273,1.25)
(3.8273,6.3273,1.25)
(3.8273,6.3273,1.25)
(3.8273,6.3273,1.25)
(3.8273,6.3273,1.25)
(3.8273,6.3273,1.25)
(3.8273,6.3273,1.25)
(3.8273,6.3273,1.25)
(0.10,0.60,0.01)
(0.10,0.60,0.01)
(1.0,2.5,0.1)
(1.0,2.5,0.1)
(0.50,5.78,0.01)
(0.100,0.775,0.001)
(0.300,0.881,0.001)""")  # "Initial interval range for each design Param"
file_path = FilePath("D:\joanna\FOR_github\AIGGC_GH\example_inputDataset.csv")

# ----
# Step 3:
# Information gain-guided control panel
# Note:
# The csv file to be analyzed needs to be input
# along with the initial range and precision of each
# design parameter (for example, if the height of a
#  window ranges from 1 meter to 2 meters and the
#  precision is 0.1, it should be written as (1.0, 2.0, 0.1)).
panel_3 = Panel("""f(EUI)
module_0
module_1
module_2
module_3
module_4
module_5
module_6
module_7
module_8
module_9
module_10
module_11
module_12
module_13
WWR_N
WWR_S
WH_N
WH_S
win_U
win_SHGC
win_VIS""")
_3_aiggctool = _3_AIGGCtool(DatasetCSVPath=file_path, DesignParameterRanges=initial_interval_range_for_each_design_p)  # -> InfoGain, GroupedNames, GroupedIGs, ConvergingBins, ConstantValues

converging_bins = Data(_3_aiggctool.ConvergingBins)

# ----
# Step 4:
# Automatic convergence
# Note:
# After inputting the Converging Bins information
# obtained in the third step into the "Interval List",
# the corresponding number of input ports will
# automatically pop up.
panel_4 = Panel(converging_bins)
decimal = ValueList({"Integer (0)": "0", "One Decimal (1)": "1", "Two Decimals (2)": "2", "Two Decimals (3)": "3"}, selected="Two Decimals (2)")
decimal_2 = ValueList({"Integer (0)": "0", "One Decimal (1)": "1", "Two Decimals (2)": "2", "Two Decimals (3)": "3"}, selected="Two Decimals (2)")
decimal_3 = ValueList({"Integer (0)": "0", "One Decimal (1)": "1", "Two Decimals (2)": "2", "Two Decimals (3)": "3"}, selected="Two Decimals (3)")
decimal_4 = ValueList({"Integer (0)": "0", "One Decimal (1)": "1", "Two Decimals (2)": "2", "Two Decimals (3)": "3"}, selected="One Decimal (1)")
decimal_5 = ValueList({"Integer (0)": "0", "One Decimal (1)": "1", "Two Decimals (2)": "2", "Two Decimals (3)": "3"}, selected="One Decimal (1)")
decimal_6 = ValueList({"Integer (0)": "0", "One Decimal (1)": "1", "Two Decimals (2)": "2", "Two Decimals (3)": "3"}, selected="Integer (0)")
decimal_7 = ValueList({"Integer (0)": "0", "One Decimal (1)": "1", "Two Decimals (2)": "2", "Two Decimals (3)": "3"}, selected="Integer (0)")
_3_converge = _3_Converge(
    Activate=Toggle(True),
    IntervalList=panel_4,
    DesignParam_15_decimal=decimal,
    DesignParam_16_decimal=decimal_2,
    DesignParam_21_decimal=decimal_3,
    DesignParam_17_decimal=decimal_4,
    DesignParam_18_decimal=decimal_5,
    DesignParam_05_decimal=decimal_6,
    DesignParam_02_decimal=decimal_7)  # -> AllValues, ParamNames
panel_5 = Panel(_3_converge.ParamNames)
panel_6 = Panel(_3_converge.AllValues)
_3_converge_2 = _3_Converge()  # -> AllValues, ParamNames

panel_7 = Panel(_3_aiggctool.InfoGain)
explode_tree = ExplodeTree(Data=panel_6)  # -> Branch0, Branch1, Branch2, Branch3, Branch4, Branch5, Branch6

# ----
# Constant_DP
constant_values = Data(_3_aiggctool.ConstantValues)
panel_8 = Panel(constant_values)

designparam_15 = Slider(24, range=0..24)
designparam_16 = Slider(24, range=0..24)
designparam_21 = Slider(347, range=0..347)
panel_9 = Panel(_3_aiggctool.GroupedNames)
designparam_02 = Slider(12, range=0..12)
designparam_17 = Slider(9, range=0..9)
designparam_18 = Slider(12, range=0..12)
designparam_05 = Slider(538, range=0..538)
data = Data(explode_tree.Branch1)
data_2 = Data(explode_tree.Branch2)
# Note:
# In the last step, after obtaining the value range of
# the converged design parameters, select the "Data"
# component, right-click "Interlise data" to separate
# the data.
data_3 = Data(["0.35", "0.36", "0.37", "0.38", "0.39", "0.4", "0.41", "0.42", "0.43", "0.44", "0.45", "0.46", "0.47", "0.48", "0.49", "0.5", "0.51", "0.52", "0.53", "0.54", "0.55", "0.56", "0.57", "0.58", "0.59"])
data_4 = Data(explode_tree.Branch3)
data_5 = Data(explode_tree.Branch5)
data_6 = Data(explode_tree.Branch6)
data_7 = Data(explode_tree.Branch4)
# Converged_DP
panel_10 = Panel(data_3)
panel_11 = Panel(data)
panel_12 = Panel(data_2)
panel_13 = Panel(data_4)
panel_14 = Panel(data_6)
panel_15 = Panel(data_7)
panel_16 = Panel(data_5)
list_item = ListItem(List=panel_11, Index=designparam_16, Wrap=True)
list_item_2 = ListItem(List=panel_10, Index=designparam_15, Wrap=True)
list_item_3 = ListItem(List=panel_12, Index=designparam_21, Wrap=True)
list_item_4 = ListItem(List=panel_13, Index=designparam_17, Wrap=True)
list_item_5 = ListItem(List=panel_14, Index=designparam_02, Wrap=True)
list_item_6 = ListItem(List=panel_16, Index=designparam_05, Wrap=True)
list_item_7 = ListItem(List=panel_15, Index=designparam_18, Wrap=True)
panel_17 = Panel(_3_aiggctool.GroupedIGs)
panel_18 = Panel(list_item_2)
panel_19 = Panel(list_item)
panel_20 = Panel(list_item_3)
panel_21 = Panel(list_item_4)
panel_22 = Panel(list_item_5)
panel_23 = Panel(list_item_7)
panel_24 = Panel(list_item_6)
